# Dynamo graph LinkedDocument.dyn (Dynamo 2.1.0.7500)

string = StringInput("C:\Users\erfajo\Programming\Source\Testing\Data\")  # graph input
string_2 = StringInput("2019_defaultProject")  # graph input
code_block = CodeBlock(a=string, b=string_2) { a+b+".rvt"; }
fromPath = Orchid.Core.File.FromPath(path=code_block)

# group: Revit links
linkedRevitFile = Orchid.RevitProject.Document.LinkedRevitFile()
linkReload = Orchid.RevitProject.Document.LinkReload(link=linkedRevitFile)  # frozen
linkRepath = Orchid.RevitProject.Document.LinkRepath(link=linkedRevitFile, file=fromPath)  # frozen
linkUnload = Orchid.RevitProject.Document.LinkUnload(link=linkedRevitFile)  # frozen
watch = Watch(linkedRevitFile)
name = Element.Name(element=linkedRevitFile)
watch_2 = Watch(name)

# group: CAD links
linkedCadFile = Orchid.RevitProject.Document.LinkedCadFile()
watch_3 = Watch(linkedCadFile)
name_2 = Element.Name(element=linkedCadFile)
watch_4 = Watch(name_2)
linkReload_2 = Orchid.RevitProject.Document.LinkReload(link=linkedCadFile)
watch_5 = Watch(linkReload_2)

# group: Get all linked files
linkedFile = Orchid.RevitProject.Document.LinkedFile()
watch_6 = Watch(linkedFile.Type)
watch_7 = Watch(linkedFile.Link)

# group: Dropdown selector
linked_files = LinkFile("Assembly Code Settings")  # graph input
watch_8 = Watch(linked_files)
linked_revit_files = LinkRevit("2020_changeMaterial.rvt")  # graph input
watch_9 = Watch(linked_revit_files)
linked_cad_files = LinkCad("Drawing1.dwg")  # graph input
watch_10 = Watch(linked_cad_files)

# group: Convert to Revit link
select_model_element = DSModelElementSelection()  # 1 picked in the model; graph input
watch_11 = Watch(select_model_element)
convertToLink = Orchid.RevitProject.Document.ConvertToLink(instance=select_model_element)
watch_12 = Watch(convertToLink)

# group: Convert to CAD link
select_model_element_2 = DSModelElementSelection()  # 1 picked in the model; graph input
watch_13 = Watch(select_model_element_2)
convertToLink_2 = Orchid.RevitProject.Document.ConvertToLink(instance=select_model_element_2)
watch_14 = Watch(convertToLink_2)
