# Dynamo graph MoveToOrigin.dyn (Dynamo 2.0.3.8810)

# group: Select special elements
element_types = ElementTypes(index=210)
all_elements_of_type = ElementsOfType(element_type=element_types)
allStackedWall = Orchid.RevitProject.Elements.Wall.AllStackedWall()
allModel = Orchid.RevitProject.Elements.Group.AllModel()
getSeparationLine = Orchid.RevitProject.Elements.SpatialElement.GetSeparationLine()
list_create = List.Create(item0=all_elements_of_type, item1=allStackedWall, item2=allModel, item3=getSeparationLine.Element)

# group: Select elements
code_block = CodeBlock()
# ---------- code_block.designscript (5 lines) ----------
// Category type elements
["Model",
"Annotation"];
"AnalyticalModel";
"Internal";
# ----------------------------------------
elementByCategoryType = Orchid.RevitProject.Elements.Selection.ElementByCategoryType(categoryType=code_block.out0)

# group: join selection
join = List.Join(list0=list_create, list1=elementByCategoryType.Element)
clean = Orchid.Core.List.Clean(list=join)
flatten = List.Flatten(list=clean)

# group: delete revisions
deleteAll = Orchid.RevitProject.Common.Revision.DeleteAll()  # frozen
await_ = Orchid.Core.DataStream.Await(pass=flatten, waitFor=deleteAll)

# group: new origin -> as vector
select_model_element = DSModelElementSelection()  # 1 picked in the model
getLocation = Element.GetLocation(element=select_model_element)
asVector = Point.AsVector(point=getLocation)
reverse = Vector.Reverse(vector=asVector)

# group: Adjust view crop box
modelAll = Orchid.RevitProject.Views.View.ModelAll()
move = Orchid.RevitProject.Views.View.Move(view=modelAll, vector=reverse)

# group: Adjust sectionsbox
code_block_2 = CodeBlock { "3D View"; }
byName = Orchid.RevitProject.Views.ViewType.ByName(name=code_block_2)
byType = Orchid.RevitProject.Views.View.ByType(viewType=byName)
moveSectionBox = Orchid.RevitProject.Views.View.MoveSectionBox(view3D=byType, vector=reverse)

# group: Select additional elements that not can be grouped
allDetail = Orchid.RevitProject.Elements.Group.AllDetail()
# note: If revisions is deleted, then remember
# to remove they are added to the list
all = Orchid.RevitProject.Common.RevisionCloud.All()

# group: Adjust model
code_block_3 = CodeBlock { "dummy"; }
create = Orchid.RevitProject.Elements.Group.Create(name=code_block_3, element=flatten)
join_2 = List.Join(list0=create, list1=allDetail, list2=all)
moveByVector = Orchid.RevitProject.Elements.Element.MoveByVector(element=join_2, vector=reverse)
await_2 = Orchid.Core.DataStream.Await(pass=create, waitFor=moveByVector)
getByGroup = Orchid.RevitProject.Elements.GroupType.GetByGroup(group=await_2)
unGroup = Orchid.RevitProject.Elements.Group.UnGroup(group=await_2)
await_3 = Orchid.Core.DataStream.Await(pass=getByGroup, waitFor=unGroup)
delete = Orchid.RevitProject.Elements.GroupType.Delete(name=await_3)
